vi "CLT.gvi"   [LabVIEW Communications System Design Suite 2.0.1]
panel controls:
  "milliseconds to wait": u32
  "number of bins": i32 = 10
panel indicators:
  "histogram": T1
  "count": i32
types:
  T1 = cluster{"x values": f64[], "histogram h(x)": f64[]}
uses:
  NI::Analysis::Statistics::Histogram (single-shot)(DBL Array).gvi
diagram:
  s1 = f64[] []  # shift register
  while (iteration -> i1) {
    Wait(time to wait=$"milliseconds to wait")
    $count <- i1
    for (N = 10) {
      for (N = 10) {
        Random Number() -> (number (0 to 1)=w3)
        Subtract(x=w3, y=0.5) -> w4
        Multiply(w4, 34.641) -> w5
        append w5 to w2
      }
      append w2 to w1
    }
    Add Array Elements(numeric array=w1) -> (sum=w6)
    Divide(x=w6, y=100) -> w7
    Insert Into Array(inArray=s1, index0=i1, new=w7) -> w8
    call "Histogram (single-shot)(DBL Array).gvi"(signal=w8, number of bins=$"number of bins") -> (histogram=w9)
    $histogram <- w9
    Is Equal(x=i1, y=999) -> w10
    next s1 = w8
    stop if w10
  }
