vi "DataTypes.gvi"   [LabVIEW Communications System Design Suite 2.0.1]
panel controls:
  "Input String": string
panel indicators:
  "Name In": u8[]
  "Converted Output": f64[]
  "Avg. Temp C": f64
  "Hot?": bool
  "Name In_2": u8[]
  "Name In_3": u8[]
diagram:
  String To Byte Array(string=$"Input String") -> (unsigned byte array=w1)
  $"Name In" <- w1
  Subtract(x=w1, y=32) -> w2
  Divide(x=w2, y=1.8) -> w3
  $"Converted Output" <- w3
  Array Size(array=w3) -> (size(s)=w4)
  Add Array Elements(numeric array=w3) -> (sum=w5)
  Divide(x=w5, y=w4) -> w6
  $"Avg. Temp C" <- w6
  Is Greater Or Equal(x=w6, y=50) -> w7
  $"Hot?" <- w7
