vi "AM.gvi"   [LabVIEW Communications System Design Suite 2.0.1]
inputs:
  "MSG_frequency": f64 = 10
  "MSG_amplitude": f64 = 1
  "Carrier_frequency": f64 = 10
  "Carrier_amplitude": f64 = 1
  "MSG_samples": i32 = 1000
  "MSG_sample rate": f64 = 1000
  "Carrier_samples": i32 = 1000
  "Carrier_sample rate": f64 = 1000
outputs:
  "MSG_signal": waveform<f64>
  "Carrier_signal": waveform<f64>
  "AM_signal": waveform<f64>
  "MSG_PSD": T1
  "AM_PSD": T1
panel indicators:
  "Carrier_PSD": T1
  "Modulation Index": f64
types:
  T1 = cluster{"f0": f64, "df": f64, "magnitude": f64[]}
uses:
  NI::Analysis::Generation::Sine Waveform.gvi
  NI::Analysis::Measurement::Power Spectral Density for 1 Chan.gvi
diagram:
  Divide(x=$MSG_amplitude, y=$Carrier_amplitude) -> w1
  $"Modulation Index" <- w1
  call "Sine Waveform.gvi"(amplitude=$MSG_amplitude, frequency=$MSG_frequency, phase in=90, sample rate=$"MSG_sample rate", samples=$MSG_samples) -> (sine wave=w2)
  $MSG_signal <- w2
  call "Power Spectral Density for 1 Chan.gvi"(signal=w2) -> (power spectral density=w3)
  $MSG_PSD <- w3
  call "Sine Waveform.gvi"(amplitude=$Carrier_amplitude, frequency=$Carrier_frequency, phase in=90, sample rate=$"Carrier_sample rate", samples=$Carrier_samples) -> (sine wave=w4)
  $Carrier_signal <- w4
  call "Power Spectral Density for 1 Chan.gvi"(signal=w4) -> (power spectral density=w5)
  $Carrier_PSD <- w5
  Waveform Divide(x=w4, y=$Carrier_amplitude) -> w6
  Waveform Multiply(w2, w6) -> w7
  Waveform Add(w4, w7) -> w8
  $AM_signal <- w8
  call "Power Spectral Density for 1 Chan.gvi"(signal=w8) -> (power spectral density=w9)
  $AM_PSD <- w9
