vi "AMCoherent.gvi"   [LabVIEW Communications System Design Suite 2.0.1]
inputs:
  "MSG_frequency": f64 = 1000
  "MSG_amplitude": f64 = 1
  "MSG_samples": i32 = 1000
  "MSG_sample rate": f64 = 20000
  "Carrier_frequency": f64 = 10000
  "Carrier_amplitude": f64 = 1
  "Carrier_samples": i32 = 1000
  "Carrier_sample rate": f64 = 20000
  "order": i32 = 2
  "cutoff frequency": f64 = 0.125
outputs:
  "Time_Domain": waveform<f64>
  "PSD": T1
types:
  T1 = cluster{"f0": f64, "df": f64, "magnitude": f64[]}
uses:
  NI::Analysis::Filtering::Butterworth Lowpass Filter (Waveform).gvi
  NI::Analysis::Measurement::AC DC and RMS (single-shot)(Wfm).gvi
  NI::Analysis::Measurement::Power Spectral Density for 1 Chan.gvi
diagram:
  call "AM.gvi"(MSG_frequency=$MSG_frequency, MSG_amplitude=$MSG_amplitude, Carrier_frequency=$Carrier_frequency, Carrier_amplitude=$Carrier_amplitude, MSG_samples=$MSG_samples, MSG_sample rate=$"MSG_sample rate", Carrier_samples=$Carrier_samples, Carrier_sample rate=$"Carrier_sample rate") -> (Carrier_signal=w1, AM_signal=w2)
  Waveform Multiply(w1, w2) -> w3
  call "Butterworth Lowpass Filter (Waveform).gvi"(signal=w3, cutoff frequency=$"cutoff frequency", order=$order) -> (filtered signal=w4)
  call "AC DC and RMS (single-shot)(Wfm).gvi"(signal=w4) -> (DC value=w5)
  Waveform Subtract(x=w4, y=w5) -> w6
  $Time_Domain <- w6
  call "Power Spectral Density for 1 Chan.gvi"(signal=w6) -> (power spectral density=w7)
  $PSD <- w7
