vi "AMEnvelopeDetection.gvi"   [LabVIEW Communications System Design Suite 2.0.1]
inputs:
  "MSG_frequency": f64 = 1000
  "MSG_amplitude": f64 = 1
  "MSG_samples": i32 = 1000
  "MSG_sample rate": f64 = 20000
  "Carrier_frequency": f64 = 10000
  "cutoff frequency": f64 = 0.125
  "Carrier_amplitude": f64 = 1
  "Carrier_sample rate": f64 = 20000
  "Carrier_samples": i32 = 1000
  "order": i32 = 2
  "error in": error
outputs:
  "Demodulated_Signal": waveform<f64>
  "Demodulated_signal_PSD": T1
  "error out": error
types:
  T1 = cluster{"f0": f64, "df": f64, "magnitude": f64[]}
uses:
  NI::Analysis::Filtering::Butterworth Lowpass Filter (Waveform).gvi
  NI::Analysis::Measurement::AC DC and RMS (single-shot)(Wfm).gvi
  NI::Analysis::Measurement::Power Spectral Density for 1 Chan.gvi
diagram:
  call "AM.gvi"(MSG_frequency=$MSG_frequency, MSG_amplitude=$MSG_amplitude, Carrier_frequency=$Carrier_frequency, Carrier_amplitude=$Carrier_amplitude, MSG_samples=$MSG_samples, MSG_sample rate=$"MSG_sample rate", Carrier_samples=$Carrier_samples, Carrier_sample rate=$"Carrier_sample rate") -> (AM_signal=w1)
  Waveform Multiply(w1, Pi) -> w2
  Property Node(instance in=w2) -> ("Y"=w3, "t0"=w4, "dt"=w5, "attributes"=w6)
  Array Size(array=w3) -> (size(s)=w7)
  for (N = w7) {
    w8 = each element of w3
    Is Greater Than 0(x=w8) -> w10
    Select(s=w10, t=w8, f=0) -> w11
    append w11 to w9
  }
  Build Waveform Node(Y=w9, attributes=w6, dt=w5, t0=w4) -> (output waveform=w12)
  call "Butterworth Lowpass Filter (Waveform).gvi"(signal=w12, cutoff frequency=$"cutoff frequency", error in=$"error in", order=$order) -> (filtered signal=w13, error out=w14)
  call "AC DC and RMS (single-shot)(Wfm).gvi"(signal=w13, error in=w14) -> (error out=w15, DC value=w16)
  Waveform Subtract(x=w13, y=w16) -> w17
  $Demodulated_Signal <- w17
  call "Power Spectral Density for 1 Chan.gvi"(signal=w17, error in=w15) -> (power spectral density=w18, error out=w19)
  $Demodulated_signal_PSD <- w18
  $"error out" <- w19
