vi "AMTopLevel.gvi"   [LabVIEW Communications System Design Suite 2.0.1]
panel controls:
  "MSG_frequency": f64 = 10
  "MSG_amplitude": f64 = 1
  "MSG_samples": i32 = 1000
  "MSG_sample rate": f64 = 1000
  "Carrier_frequency": f64 = 10
  "Carrier_amplitude": f64 = 1
  "Carrier_sample rate": f64 = 1000
  "Carrier_samples": i32 = 1000
  "order": i32 = 2
  "cutoff frequency": f64 = 0.125
  "error in": error
  "stop": bool
panel indicators:
  "AM_signal": waveform<f64>
  "AM_PSD": T1
  "AM_Co_signal": waveform<f64>
  "AM_Co_PSD": T1
  "AM_En_signal": waveform<f64>
  "AM_En_PSD": T1
types:
  T1 = cluster{"f0": f64, "df": f64, "magnitude": f64[]}
diagram:
  while {
    call "AM.gvi"(MSG_frequency=$MSG_frequency, MSG_amplitude=$MSG_amplitude, Carrier_frequency=$Carrier_frequency, Carrier_amplitude=$Carrier_amplitude, MSG_samples=$MSG_samples, MSG_sample rate=$"MSG_sample rate", Carrier_samples=$Carrier_samples, Carrier_sample rate=$"Carrier_sample rate") -> (AM_signal=w1, AM_PSD=w2)
    $AM_signal <- w1
    $AM_PSD <- w2
    call "AMCoherent.gvi"(MSG_frequency=$MSG_frequency, MSG_amplitude=$MSG_amplitude, MSG_samples=$MSG_samples, MSG_sample rate=$"MSG_sample rate", Carrier_frequency=$Carrier_frequency, Carrier_amplitude=$Carrier_amplitude, Carrier_samples=$Carrier_samples, Carrier_sample rate=$"Carrier_sample rate", order=$order, cutoff frequency=$"cutoff frequency") -> (Time_Domain=w3, PSD=w4)
    $AM_Co_signal <- w3
    $AM_Co_PSD <- w4
    call "AMEnvelopeDetection.gvi"(MSG_frequency=$MSG_frequency, MSG_amplitude=$MSG_amplitude, MSG_samples=$MSG_samples, MSG_sample rate=$"MSG_sample rate", Carrier_frequency=$Carrier_frequency, cutoff frequency=$"cutoff frequency", Carrier_amplitude=$Carrier_amplitude, Carrier_sample rate=$"Carrier_sample rate", Carrier_samples=$Carrier_samples, order=$order, error in=$"error in") -> (Demodulated_Signal=w5, Demodulated_signal_PSD=w6)
    $AM_En_signal <- w5
    $AM_En_PSD <- w6
    stop if $stop
  }
