vi "FMTopLevel.gvi"   [LabVIEW Communications System Design Suite 2.0.1]
panel controls:
  "stop": bool
  "cutoff frequency": f64 = 0.125
  "order": i32 = 2
  "Msg_amplitude": f64 = 1
  "Msg_frequency": f64 = 10
  "Carrier_amplitude": f64 = 1
  "Carrier_frequency": f64
  "Delta f": f64
  "sample rate": f64 = 1000
  "samples": i32 = 1000
panel indicators:
  "FM": waveform<f64>
  "FM_PSD": T1
  "Demodulation": waveform<f64>
  "Demodulation_PSD": T1
types:
  T1 = cluster{"f0": f64, "df": f64, "magnitude": f64[]}
diagram:
  while {
    call "FM_Modulator.gvi"(Msg_amplitude=$Msg_amplitude, Msg_frequency=$Msg_frequency, Carrier_amplitude=$Carrier_amplitude, Carrier_frequency=$Carrier_frequency, Delta f=$"Delta f", sample rate=$"sample rate", samples=$samples) -> (FM=w1, FM_PSD=w2, Carrier_amplitude_out=w3, Carrier_frequency_out=w4)
    $FM_PSD <- w2
    $FM <- w1
    call "FM_Demodulation.gvi"(waveform in=w1, Carrier_amp=w3, Carrier_frequency=w4, cutoff frequency=$"cutoff frequency", order=$order) -> (Demodulated_signal=w5, Demodulated_signal_PSD=w6)
    $Demodulation <- w5
    $Demodulation_PSD <- w6
    stop if $stop
  }
