vi "FM_Demodulation.gvi"   [LabVIEW Communications System Design Suite 2.0.1]
inputs:
  "waveform in": waveform<f64> = {dt=1, Y=[]}
  "Carrier_amp": f64
  "Carrier_frequency": f64
  "error in": error
  "cutoff frequency": f64 = 0.125
  "order": i32 = 2
outputs:
  "Demodulated_signal": waveform<f64>
  "Demodulated_signal_PSD": T1
  "error out": error
types:
  T1 = cluster{"f0": f64, "df": f64, "magnitude": f64[]}
uses:
  NI::Analysis::IntegralDifferentiation::Derivative x(t).gvi
diagram:
  Property Node(instance in=$"waveform in") -> ("Y"=w1, "t0"=w2, "dt"=w3, "attributes"=w4)
  call "Derivative x(t).gvi"(x(t)=w1, dt=w3, error in=$"error in") -> (error out=w5, dx(t)/dt=w6)
  Multiply($Carrier_amp, $Carrier_frequency) -> w7
  Build Waveform Node(Y=w6, attributes=w4, dt=w3, t0=w2) -> (output waveform=w8)
  Waveform Divide(x=w8, y=w7) -> w9
  call "FM_Envelop.gvi"(waveform_in=w9, cutoff frequency=$"cutoff frequency", order=$order, error in=w5) -> (Demodulated_Signal=w10, Demodulated_signal_PSD=w11, error out=w12)
  $Demodulated_signal <- w10
  $Demodulated_signal_PSD <- w11
  $"error out" <- w12
