vi "FM_Envelop.gvi"   [LabVIEW Communications System Design Suite 2.0.1]
inputs:
  "waveform_in": waveform<f64> = {dt=1, Y=[]}
  "cutoff frequency": f64 = 0.125
  "order": i32 = 2
  "error in": error
outputs:
  "Demodulated_Signal": waveform<f64>
  "Demodulated_signal_PSD": T1
  "error out": error
types:
  T1 = cluster{"f0": f64, "df": f64, "magnitude": f64[]}
uses:
  NI::Analysis::Filtering::Butterworth Lowpass Filter (Waveform).gvi
  NI::Analysis::Measurement::AC DC and RMS (single-shot)(Wfm).gvi
  NI::Analysis::Measurement::Power Spectral Density for 1 Chan.gvi
diagram:
  Property Node(instance in=$waveform_in) -> ("Y"=w1, "t0"=w2, "dt"=w3, "attributes"=w4)
  Array Size(array=w1) -> (size(s)=w5)
  for (N = w5) {
    w6 = each element of w1
    Is Greater Than 0(x=w6) -> w8
    Select(s=w8, t=w6, f=0) -> w9
    append w9 to w7
  }
  Build Waveform Node(Y=w7, attributes=w4, dt=w3, t0=w2) -> (output waveform=w10)
  call "Butterworth Lowpass Filter (Waveform).gvi"(signal=w10, cutoff frequency=$"cutoff frequency", error in=$"error in", order=$order) -> (filtered signal=w11, error out=w12)
  call "AC DC and RMS (single-shot)(Wfm).gvi"(signal=w11, error in=w12) -> (error out=w13, DC value=w14)
  Waveform Subtract(x=w11, y=w14) -> w15
  $Demodulated_Signal <- w15
  call "Power Spectral Density for 1 Chan.gvi"(signal=w15, error in=w13) -> (power spectral density=w16, error out=w17)
  $Demodulated_signal_PSD <- w16
  $"error out" <- w17
