vi "FM_Modulator.gvi"   [LabVIEW Communications System Design Suite 2.0.1]
inputs:
  "Msg_amplitude": f64 = 1
  "Msg_frequency": f64 = 10
  "Carrier_amplitude": f64 = 1
  "Carrier_frequency": f64
  "Delta f": f64
  "sample rate": f64 = 1000
  "samples": i32 = 1000
outputs:
  "MSG": waveform<f64>
  "MSG_PSD": T1
  "FM": waveform<f64>
  "FM_PSD": T1
  "Carrier_amplitude_out": f64
  "Carrier_frequency_out": f64
types:
  T1 = cluster{"f0": f64, "df": f64, "magnitude": f64[]}
uses:
  NI::Analysis::Generation::Sine Waveform.gvi
  NI::Analysis::Measurement::Power Spectral Density for 1 Chan.gvi
  NI::Analysis::IntegralDifferentiation::Integral x(t).gvi
diagram:
  call "Sine Waveform.gvi"(amplitude=$Msg_amplitude, frequency=$Msg_frequency, phase in=0, sample rate=$"sample rate", samples=$samples) -> (sine wave=w1)
  $MSG <- w1
  call "Power Spectral Density for 1 Chan.gvi"(signal=w1) -> (power spectral density=w2)
  $MSG_PSD <- w2
  call "Sine Waveform.gvi"(amplitude=$Carrier_amplitude, frequency=$Carrier_frequency, phase in=90, sample rate=$"sample rate", samples=$samples) -> (sine wave=w3)
  Property Node(instance in=w1) -> ("Y"=w4, "t0"=w5, "dt"=w6, "attributes"=w7)
  call "Integral x(t).gvi"(x(t)=w4, dt=w6) -> (integral x(t)=w8)
  Multiply(Pi, 2) -> w9
  Multiply(w9, $"Delta f") -> w10
  Multiply(w10, w8) -> w11
  Sine And Cosine(x=w11) -> (cos(x)=w12, sin(x)=w13)
  Build Waveform Node(Y=w12, attributes=w7, dt=w6, t0=w5) -> (output waveform=w14)
  Waveform Multiply(w14, w3) -> w15
  call "Sine Waveform.gvi"(amplitude=$Carrier_amplitude, frequency=$Carrier_frequency, phase in=0, sample rate=$"sample rate", samples=$samples) -> (sine wave=w16)
  Build Waveform Node(Y=w13, attributes=w7, dt=w6, t0=w5) -> (output waveform=w17)
  Waveform Multiply(w17, w16) -> w18
  Waveform Subtract(x=w15, y=w18) -> w19
  $FM <- w19
  $Carrier_amplitude_out <- $Carrier_amplitude
  call "Power Spectral Density for 1 Chan.gvi"(signal=w19) -> (power spectral density=w20)
  $FM_PSD <- w20
  $Carrier_frequency_out <- $Carrier_frequency
