vi "FFT Power Spectrum for 1 Chan (CDB)3.gvi"   [LabVIEW Communications System Design Suite 2.0.1]
inputs:
  "time signal": cluster{"Y": c128[], "dt": f64, "t0": timestamp}
  "window": u32 = 1
  "dB On (F)": bool
  "error in (no error)": error
  "restart averaging (F)": bool
  "averaging parameters": T3 = {"averaging mode"="No averaging", "weighting mode"="Exponential", "number of averages"=10}
outputs:
  "power spectrum": T1
  "averages completed": f64
  "Error Out": error
  "averaging done": bool
types:
  T1 = cluster{"f0": f64, "df": f64, "magnitude": f64[]}
  T2 = enum{"No averaging", "Vector averaging", "RMS averaging", "Peak hold"}
  T3 = cluster{"averaging mode": T2, "weighting mode": enum{"Linear", "Exponential"}, "number of averages": u32}
  T4 = cluster{"averaging parameters": T3, "window": u32}
  T5 = cluster{"block size": i32, "dt": f64, "spectrum parameters": T4, "df": f64, "averages completed": f64, "complex spectrum": c128[], "real spectrum": f64[], "t0 history": f64, "dt history": f64, "timestamp": f64, "lin avg done": bool}
uses:
  NI::Analysis::Measurement::ma_FFT Power Spectrum and PS Density no State Compatibility (CDB).gvi
diagram:
  case ($"error in (no error)") {
    frame No Error {
      Is First Call() -> w2
      Logical Or($"restart averaging (F)", w2) -> w3
      Property Node(instance in=$"time signal") -> ("Y"=w4, "dt"=w5, "t0"=w6)
      Build Cluster(w6, w5, w4) -> w7
      s1 = uninitialised  # shift register
      while {
        Select(s=w3, t=T5 {all zero or empty}, f=s1) -> w8
        call "ma_FFT Power Spectrum and PS Density no State Compatibility (CDB).gvi"(time signal=w7, window=$window, averaging parameters=$"averaging parameters", dB On (F)=$"dB On (F)", Error In=$"error in (no error)", restart averaging (F)=w3, ps density=FALSE, state info=w8) -> (power spectrum=w9, averages completed=w10, Error Out=w1, averaging done=w11, state info 2=w12)
        next s1 = w12
        continue if FALSE
      }
      $"averaging done" <- w11
      $"power spectrum" <- w9
      $"averages completed" <- w10
    }
    frame Error {
      w1 = $"error in (no error)"
    }
  }
  $"Error Out" <- w1
