vi "FM Music.gvi"   [LabVIEW Communications System Design Suite 2.0.1]
panel controls:
  "Stop": bool
  "active antenna": string = "RX1"
  "IQ rate": f64 = 200000
  "carrier frequency": f64 = 95700000
  "gain": f64
  "number of samples": i64 = 10000
  "Low cutoff freq": f64 = 10000
  "delta f_demod": f64 = 500
  "device names": "niUSRPClass"
panel indicators:
  "coerced gain": f64
  "coerced frequency": f64
  "coerced IQ rate": f64
  "Error Out": error
  "Demod. Msg (Time domain)": waveform<f64>
  "Demod. Msg (Freq domain)": T1
types:
  T1 = cluster{"f0": f64, "df": f64, "magnitude": f64[]}
uses:
  NI::Analysis::IntegralDifferentiation::Derivative x(t).gvi
  NI::Analysis::Filtering::Butterworth Lowpass Filter (DBL).gvi
  NI::Analysis::Measurement::AC DC and RMS (single-shot)(1D DBL).gvi
  NI::Analysis::Measurement::Power Spectrum for 1 Chan.gvi
diagram:
  call "niUSRP Open Rx Session.gvi"(device names=$"device names") -> (error out=w1, session handle out=w2)
  call "niUSRP Configure Signal.gvi"(session handle=w2, IQ rate=$"IQ rate", carrier frequency=$"carrier frequency", gain=$gain, error in=w1, active antenna=$"active antenna") -> (session handle out=w3, coerced IQ rate=w4, coerced carrier frequency=w5, coerced gain=w6, error out=w7)
  call "niUSRP Initiate.gvi"(session handle=w3, error in=w7) -> (session handle out=w8, error out=w9)
  call "Simple Sound.gvi"(Action="Open") -> (sample rate (S/s)=w10, Error=w11, task ID=w12)
  Reciprocal(x=w4) -> w13
  while {
    call "niUSRP Fetch Rx Data (CDB Cluster).gvi"(session handle=w8, number of samples=$"number of samples", error in=w9) -> (session handle out=w14, data=w15, error out=w16)
    Property Node(instance in=w15) -> ("Y"=w17, "dt"=w18)
    Complex To Real Imaginary(x + iy=w17) -> (x=w19, y=w20)
    call "Derivative x(t).gvi"(x(t)=w19, dt=w18) -> (dx(t)/dt=w21)
    Multiply(w21, w20) -> w22
    Reciprocal(x=w18) -> w23
    call "Butterworth Lowpass Filter (DBL).gvi"(signal=w22, sampling frequency=w23, cutoff frequency=$"Low cutoff freq", order=5) -> (filtered signal=w24)
    call "AC DC and RMS (single-shot)(1D DBL).gvi"(signal=w24) -> (DC value=w25)
    Subtract(x=w24, y=w25) -> w26
    Multiply(PiTimes2, $"delta f_demod") -> w27
    Divide(x=w26, y=w27) -> w28
    Build Waveform Node(Y=w28, dt=w18) -> (output waveform=w29)
    $"Demod. Msg (Time domain)" <- w29
    call "Power Spectrum for 1 Chan.gvi"(signal=w29) -> (power spectrum=w30)
    $"Demod. Msg (Freq domain)" <- w30
    Property Node(instance in=w16) -> ("status"=w31)
    call "Simple Resample.gvi"(input=w28, coerced IQ rate=w4, sample rate (S/s)=w10) -> (output=w32)
    Build Waveform Node(Y=w32, dt=w13) -> (output waveform=w33)
    call "Simple Sound.gvi"(device ID=w12, error in (no error)=w11, Action="Write", data=w33) -> (Error=w34, task ID=w35)
    Property Node(instance in=w34) -> ("status"=w36)
    Logical Or(w36, w31, $Stop) -> w37
    stop if w37
  }
  call "Simple Sound.gvi"(device ID=w35, error in (no error)=w34, Action="Close") -> (Error=w38)
  Merge Errors(w16, w38) -> (error out=w39)
  call "niUSRP Abort.gvi"(session handle=w14, error in=w39) -> (session handle out=w40, error out=w41)
  call "niUSRP Close Session.gvi"(session handle=w40, error in=w41) -> (error out=w42)
  $"Error Out" <- w42
  $"coerced IQ rate" <- w4
  $"coerced frequency" <- w5
  $"coerced gain" <- w6
