vi "Simple Resample.gvi"   [LabVIEW NXG]
inputs:
  "input": f64[]
  "coerced IQ rate": f64
  "sample rate (S/s)": f64
outputs:
  "output": f64[]
diagram:
  w1 = cluster{"interpolation": i32, "decimation": i32} {"interpolation"=1, "decimation"=1}
  Property Node(instance in=w1, "decimation"=$"coerced IQ rate", "interpolation"=$"sample rate (S/s)") -> (instance out=w2)
  call "Rational Resample (single channel, DBL).gvi"(x=$input, resample factor=w2) -> (y=w3)
  $output <- w3
