vi "ma_MultitoneParamsCheck.gvi"   [LabVIEW NXG]
inputs:
  "Tone Amplitudes": f64[]
  "Tone Frequencies": f64[]
  "Sampling Rate": f64
  "error in (no error)": error
  "Samples": i32
  "Relative error": f64 = 1e-09
  "Phases": f64[]
  "coerce frequencies?": bool
outputs:
  "Tone Amplitudes out": f64[]
  "Tone Frequencies out": f64[]
  "Phases out": f64[]
  "error out": error
diagram:
  case ($"error in (no error)") {
    frame No Error {
      sequence {
        frame 0 {
          Is Less Or Equal To 0(x=$Samples) -> w5
          # Input parameter is invalid
          # Basic parameter range checking
          Array Size(array=$"Tone Frequencies") -> (size(s)=w6)
          Is Less Or Equal To 0(x=w6) -> w7
          Is Less Than 0(x=$"Tone Frequencies") -> w8
          Or Array Elements(Boolean array=w8) -> (logical OR=w9)
          Is Less Or Equal To 0(x=$"Sampling Rate") -> w10
          Logical Or(w7, w9, w10, w5) -> w11
          Select(s=w11, t=-20061, f=0) -> w12
          call "ma_basicErrorCode2ErrorCluster.gvi"(Error Code=w12, error in (no error)=$"error in (no error)") -> (Error Out=w13)
        }
        frame 1 {
          # Input sequences do not have
          #  the same number of samples
          # Do the array sizes match?
          Array Size(array=$Phases) -> (size(s)=w14)
          Array Size(array=$"Tone Frequencies") -> (size(s)=w15)
          Is Not Equal(x=w14, y=w15) -> w16
          Array Size(array=$"Tone Amplitudes") -> (size(s)=w17)
          Is Not Equal(x=w15, y=w17) -> w18
          Logical Or(w16, w18) -> w19
          Select(s=w19, t=-20002, f=0) -> w20
          call "ma_basicErrorCode2ErrorCluster.gvi"(Error Code=w20, error in (no error)=$"error in (no error)") -> (Error Out=w21)
        }
        frame 2 {
          # Nyquist check
          # Tone frequencies
          # Tone amplitudes
          # Tone phases
          Divide(x=$"Sampling Rate", y=$Samples) -> w22
          Divide(x=$"Sampling Rate", y=2) -> w23
          # Is the Nyquist criteria violated?
          s1 = f64[] []  # shift register
          s2 = FALSE  # shift register
          s3 = f64[] []  # shift register
          s4 = f64[] []  # shift register
          for {
            w24 = each element of $"Tone Frequencies"
            w25 = each element of $"Tone Amplitudes"
            w26 = each element of $Phases
            case ($"coerce frequencies?") {
              frame False, Default {
                w27 = w24
              }
              frame True {
                Divide(x=w24, y=w22) -> w28
                Round To Nearest(number=w28) -> w29
                Multiply(w29, w22) -> w27
              }
            }
            Is Greater Or Equal(x=w27, y=w23) -> w30
            case (w30) {
              frame False, Default {
                Logical Or(w30, s2) -> w31
                Build Array[ConcatenateInputs=True](s1, w27) -> w32
                Is Equal To 0(x=w27) -> w35
                # Wrap the phase and convert to radians
                case (w35) {
                  frame False, Default {
                    w36 = w26
                    w37 = w25
                  }
                  frame True {
                    # Adjust
                    # magnitude
                    # if this is DC
                    Multiply(w25, 2) -> w37
                    w36 = 90
                  }
                }
                Build Array[ConcatenateInputs=True](s4, w37) -> w34
                Divide(x=w36, y=360) -> w38
                Round Toward Negative Infinity(x=w38) -> w39
                Subtract(x=w38, y=w39) -> w40
                Multiply(w40, 6.28318530718) -> w41
                Build Array[ConcatenateInputs=True](s3, w41) -> w33
              }
              frame True {
                Logical Or(w30, s2) -> w31
                w32 = s1
                w33 = s3
                w34 = s4
              }
            }
            next s1 = w32
            next s2 = w31
            next s3 = w33
            next s4 = w34
          }
          Select(s=s2, t=20020, f=0) -> w42
          call "ma_basicErrorCode2ErrorCluster.gvi"(Error Code=w42, error in (no error)=$"error in (no error)") -> (Error Out=w43)
        }
        frame 3 {
          # Check for integer number of cycles to be represented
          # in the output waveform.
          case ($"coerce frequencies?") {
            frame False, Default {
              Divide(x=$"Sampling Rate", y=$Samples) -> w45
              Divide(x=$"Tone Frequencies", y=w45) -> w46
              Round To Nearest(number=w46) -> w47
              Subtract(x=w46, y=w47) -> w48
              Absolute Value(x=w48) -> w49
              Is Greater(x=w49, y=$"Relative error") -> w50
              Or Array Elements(Boolean array=w50) -> (logical OR=w51)
              # Frequency not an even
              # multiple of (Sampling Rate)/Samples
              Select(s=w51, t=-20307, f=0) -> w44
            }
            frame True {
              w44 = 0
            }
          }
          call "ma_basicErrorCode2ErrorCluster.gvi"(Error Code=w44, error in (no error)=$"error in (no error)") -> (Error Out=w52)
        }
      }
      Build Array(w21, w13, w43, w52) -> w53
      Merge Errors(w53) -> (error out=w4)
      w1 = s3
      w2 = s4
      w3 = s1
    }
    frame Error {
      w1 = $Phases
      w2 = $"Tone Amplitudes"
      w3 = $"Tone Frequencies"
      w4 = $"error in (no error)"
    }
  }
  $"error out" <- w4
  $"Tone Frequencies out" <- w3
  $"Tone Amplitudes out" <- w2
  $"Phases out" <- w1
