vi "BPSK_receiver_new.gvi"   [LabVIEW Communications System Design Suite 2.0.1]
panel controls:
  "IQ rate": f64 = 200000
  "device names": "niUSRPClass"
  "carrier frequency": f64 = 400000000
  "gain Tx": f64
  "active antenna Tx": string = "TX1"
  "stop Tx": bool
  "gain Rx": f64
  "active antenna Rx": string = "RX2"
  "total bits": i32 = 128
  "Symbol Rate": f64
panel indicators:
  "Baseband Power Spectrum": T1
  "upsampling factor L": f64
  "Baseband_Waveform": waveform<f64>
  "BER": f64
  "Output Bits": i16[]
  "trigger found?": bool
types:
  T1 = cluster{"f0": f64, "df": f64, "magnitude": f64[]}
uses:
  NI::Analysis::Resampling::Upsample (DBL).gvi
  NI::Analysis::Operations::1D Convolution (DBL).gvi
  NI::Analysis::Resampling::Decimate (single shot, CDB).gvi
diagram:
  Reciprocal(x=$"IQ rate") -> w1
  w2 = $"total bits"
  call "MT Generate Bits (Fibonacci, PN Order).gvi"(total bits=w2) -> (output bit stream=w3)
  for (N = w2) {
    w4 = each element of w3
    Is Equal To 0(x=w4) -> w6
    Select(s=w6, t=-1, f=1) -> w7
    append w7 to w5
  }
  call "AddFrameHeader.gvi"(array=w5) -> (output array=w8)
  Divide(x=$"IQ rate", y=$"Symbol Rate") -> w9
  call "Upsample (DBL).gvi"(input array=w8, upsampling factor=w9) -> (upsampled array=w10)
  call "MT Generate Filter Coefficients.gvi"(pulse shaping filter="Root Raised Cos", pulse shaping samples per symbol=w9, modulation type="PSK") -> (pulse shaping filter coefficients=w11)
  call "1D Convolution (DBL).gvi"(x=w10, y=w11) -> (x * y=w12)
  call "Quick Scale 1D.gvi"(X=w12) -> (Y[i]=X[i]/Max|X|=w13)
  Build Waveform Node(Y=w13, dt=w1) -> (output waveform=w14)
  $Baseband_Waveform <- w14
  $"upsampling factor L" <- w9
  w15 = cluster{"t0": timestamp, "dt": f64, "Y": c128[]} {all zero or empty}
  Property Node(instance in=w15, "dt"=w1, "Y"=w13) -> (instance out=w16)
  call "FFT Power Spectrum for 1 Chan (CDB)2.gvi"(time signal=w16, dB On (F)=TRUE) -> (power spectrum=w17)
  $"Baseband Power Spectrum" <- w17
  call "niUSRP Open Rx Session.gvi"(device names=$"device names") -> (error out=w18, session handle out=w19)
  call "niUSRP Configure Signal.gvi"(session handle=w19, IQ rate=$"IQ rate", carrier frequency=$"carrier frequency", gain=$"gain Rx", error in=w18, active antenna=$"active antenna Rx") -> (session handle out=w20, coerced carrier frequency=w21, error out=w22)
  Subtract(x=w21, y=20000) -> w23
  Property Node(instance in=w20, "LO Frequency"=w23) -> (instance out=w24)
  call "niUSRP Initiate.gvi"(session handle=w24, error in=w22) -> (session handle out=w25, error out=w26)
  call "niUSRP Fetch Rx Data (CDB).gvi"(session handle=w25, number of samples=1000000, error in=w26) -> (session handle out=w27, data=w28, error out=w29)
  call "niUSRP Close Session.gvi"(session handle=w27, error in=w29)
  call "niUSRP Open Tx Session.gvi"(device names=$"device names") -> (session handle out=w30, error out=w31)
  call "niUSRP Configure Signal.gvi"(session handle=w30, IQ rate=$"IQ rate", carrier frequency=$"carrier frequency", gain=$"gain Tx", error in=w31, active antenna=$"active antenna Tx") -> (session handle out=w32, error out=w33)
  To Double Precision Complex(number=w13) -> w34
  call "Insert Pilots.gvi"(signal input=w34) -> (output signal=w35)
  call "AddFrameHeader (complex).gvi"(array=w35) -> (output array=w36)
  while {
    call "niUSRP Write Tx Data (CDB).gvi"(session handle=w32, data=w36, error in=w33) -> (session handle out=w37, error out=w38)
    stop if $"stop Tx"
  }
  call "niUSRP Close Session.gvi"(session handle=w37, error in=w38)
  call "FrameSync.gvi"(Sampled Input=w28) -> (Aligned Samples=w39)
  call "Channel Estimator.gvi"(input signal=w39) -> (signal out=w40)
  Complex To Real Imaginary(x + iy=w40) -> (x=w41)
  call "MT Generate Filter Coefficients.gvi"(pulse shaping filter="Root Raised Cos", matched samples per symbol=w9, modulation type="PSK") -> (matched filter coefficients=w42)
  call "1D Convolution (DBL).gvi"(x=w41, y=w42) -> (x * y=w43)
  w44 = cluster{"t0": timestamp, "dt": f64, "Y": c128[]} {all zero or empty}
  Property Node(instance in=w44, "dt"=$"IQ rate", "Y"=w43)
  call "PulseAlign.gvi"(Input signal=w43, Receiver Sampling Factor=w9) -> (aligned output=w45)
  call "Decimate (single shot, CDB).gvi"(input array=w45, decimating factor=w9)
  call "FrameSync.gvi"(Sampled Input=w28)
  call "PulseAlign.gvi"(Input signal=_, Receiver Sampling Factor=_) -> (aligned output=w46)
  call "Decimate (single shot, CDB).gvi"(input array=w46, decimating factor=_) -> (decimated array=w47)
  call "FrameSync.gvi"(Sampled Input=w47) -> (Aligned Samples=w48)
  Complex To Real Imaginary(x + iy=w48) -> (x=w49)
  Is Greater Than 0(x=w49) -> w50
  Boolean To Integer(Boolean=w50) -> (0, 1=w51)
  Array Subset(array=w51, index0=0) -> (subarray=w52, length0=w53)
  $"Output Bits" <- w52
  w54 = cluster{"t0": timestamp, "dt": f64, "Y": c128[]} {all zero or empty}
  Property Node(instance in=w54)
  call "MT Calculate BER After Trigger (Fibonacci PN Sequence).gvi"(input bit stream=w52, BER trigger threshold=0.4) -> (BER=w55, trigger found?=w56)
  $"trigger found?" <- w56
