vi "DPSK.gvi"   [LabVIEW Communications System Design Suite 2.0.1]
panel controls:
  "IQ rate": f64 = 200000
  "device names": "niUSRPClass"
  "carrier frequency": f64 = 400000000
  "gain Tx": f64
  "active antenna Tx": string = "TX1"
  "stop Tx": bool
  "gain Rx": f64
  "active antenna Rx": string = "RX2"
  "total bits": i32 = 128
  "Symbol Rate": f64
panel indicators:
  "Baseband Power Spectrum": T1
  "upsampling factor L": f64
  "Baseband_Waveform": waveform<f64>
  "Output Bits": i16[]
  "BER": f64
  "trigger found?": bool
types:
  T1 = cluster{"f0": f64, "df": f64, "magnitude": f64[]}
uses:
  NI::Analysis::Resampling::Upsample (DBL).gvi
  NI::Analysis::Operations::1D Convolution (DBL).gvi
  NI::Analysis::Operations::1D Convolution (CDB).gvi
  NI::Analysis::Resampling::Decimate (single shot, CDB).gvi
diagram:
  Reciprocal(x=$"IQ rate") -> w1
  w2 = $"total bits"
  call "MT Generate Bits (Fibonacci, PN Order).gvi"(total bits=w2) -> (output bit stream=w3)
  Multiply(w3, 2) -> w4
  Subtract(x=w4, y=1) -> w5
  call "AddFrameHeader.gvi"(array=w5) -> (output array=w6)
  s1 = 1  # shift register
  for (N = w2) {
    w7 = each element of w6
    Is Equal(x=s1, y=w7) -> w9
    Select(s=w9, t=1, f=-1) -> w10
    append w10 to w8
    next s1 = w10
  }
  Divide(x=$"IQ rate", y=$"Symbol Rate") -> w11
  call "Upsample (DBL).gvi"(input array=w8, upsampling factor=w11) -> (upsampled array=w12)
  call "MT Generate Filter Coefficients.gvi"(pulse shaping filter="Root Raised Cos", pulse shaping samples per symbol=w11, modulation type="PSK") -> (pulse shaping filter coefficients=w13)
  call "1D Convolution (DBL).gvi"(x=w12, y=w13) -> (x * y=w14)
  call "Quick Scale 1D.gvi"(X=w14) -> (Y[i]=X[i]/Max|X|=w15)
  Build Waveform Node(Y=w15, dt=w1) -> (output waveform=w16)
  $Baseband_Waveform <- w16
  $"upsampling factor L" <- w11
  w17 = cluster{"t0": timestamp, "dt": f64, "Y": c128[]} {all zero or empty}
  Property Node(instance in=w17, "dt"=w1, "Y"=w15) -> (instance out=w18)
  call "FFT Power Spectrum for 1 Chan (CDB)2.gvi"(time signal=w18, dB On (F)=TRUE) -> (power spectrum=w19)
  $"Baseband Power Spectrum" <- w19
  call "niUSRP Open Rx Session.gvi"(device names=$"device names") -> (error out=w20, session handle out=w21)
  call "niUSRP Configure Signal.gvi"(session handle=w21, IQ rate=$"IQ rate", carrier frequency=$"carrier frequency", gain=$"gain Rx", error in=w20, active antenna=$"active antenna Rx") -> (session handle out=w22, coerced carrier frequency=w23, error out=w24)
  Subtract(x=w23, y=20000) -> w25
  Property Node(instance in=w22, "LO Frequency"=w25) -> (instance out=w26)
  call "niUSRP Initiate.gvi"(session handle=w26, error in=w24) -> (session handle out=w27, error out=w28)
  call "niUSRP Fetch Rx Data (CDB).gvi"(session handle=w27, number of samples=1000000, error in=w28) -> (session handle out=w29, data=w30, error out=w31)
  call "niUSRP Close Session.gvi"(session handle=w29, error in=w31)
  call "niUSRP Open Tx Session.gvi"(device names=$"device names") -> (session handle out=w32, error out=w33)
  call "niUSRP Configure Signal.gvi"(session handle=w32, IQ rate=$"IQ rate", carrier frequency=$"carrier frequency", gain=$"gain Tx", error in=w33, active antenna=$"active antenna Tx") -> (session handle out=w34, error out=w35)
  while {
    call "niUSRP Write Tx Data (CDB).gvi"(session handle=w34, data=w15, error in=w35) -> (session handle out=w36, error out=w37)
    stop if $"stop Tx"
  }
  call "niUSRP Close Session.gvi"(session handle=w36, error in=w37)
  call "MT Generate Filter Coefficients.gvi"(pulse shaping filter="Root Raised Cos", matched samples per symbol=w11, modulation type="PSK") -> (matched filter coefficients=w38)
  call "1D Convolution (CDB).gvi"(x=w30, y=w38) -> (x * y=w39)
  call "PulseAlign.gvi"(Input signal=w39, Receiver Sampling Factor=w11) -> (aligned output=w40)
  call "Decimate (single shot, CDB).gvi"(input array=w40, decimating factor=w11) -> (decimated array=w41)
  Array Index(array=w41) -> (out0[0]=w42)
  s2 = w42  # shift register
  for {
    w43 = each element of w41
    Complex Conjugate(x + iy=s2) -> w45
    Multiply(w43, w45) -> w46
    append w46 to w44
    next s2 = w43
  }
  call "FrameSync.gvi"(Sampled Input=w44) -> (Aligned Samples=w47)
  Complex To Real Imaginary(x + iy=w47) -> (x=w48)
  Is Greater Than 0(x=w48) -> w49
  Boolean To Integer(Boolean=w49) -> (0, 1=w50)
  Array Subset(array=w50, index0=0, length0=w2) -> w51
  $"Output Bits" <- w51
  call "MT Calculate BER After Trigger (Fibonacci PN Sequence).gvi"(input bit stream=w51, BER trigger threshold=0.4) -> (BER=w52, trigger found?=w53)
  $BER <- w52
  $"trigger found?" <- w53
