vi "Error Correction Coding.gvi"   [LabVIEW Communications System Design Suite 2.0.1]
panel controls:
  "IQ rate": f64 = 200000
  "device names": "niUSRPClass"
  "carrier frequency": f64 = 400000000
  "gain Tx": f64
  "active antenna Tx": string = "TX1"
  "stop Tx": bool
  "gain Rx": f64
  "active antenna Rx": string = "RX2"
  "total bits": i32 = 128
  "Symbol Rate": f64
panel indicators:
  "Baseband Power Spectrum": T1
  "upsampling factor L": f64
  "Baseband_Waveform": waveform<c128>
  "Output Bits": i16[]
  "BER": f64
  "trigger found?": bool
types:
  T1 = cluster{"f0": f64, "df": f64, "magnitude": f64[]}
uses:
  NI::Analysis::Resampling::Upsample (DBL).gvi
  NI::Analysis::Operations::1D Convolution (DBL).gvi
  NI::Analysis::Resampling::Decimate (single shot, CDB).gvi
diagram:
  Reciprocal(x=$"IQ rate") -> w1
  w2 = $"total bits"
  call "MT Generate Bits (Fibonacci, PN Order).gvi"(total bits=w2) -> (output bit stream=w3)
  Build Array[ConcatenateInputs=True](w3, w3, w3) -> w4
  for (N = w2) {
    w5 = each element of w4
    Is Equal To 0(x=w5) -> w7
    Select(s=w7, t=-1, f=1) -> w8
    append w8 to w6
  }
  call "AddFrameHeader.gvi"(array=w6) -> (output array=w9)
  Divide(x=$"IQ rate", y=$"Symbol Rate") -> w10
  call "Upsample (DBL).gvi"(input array=w9, upsampling factor=w10) -> (upsampled array=w11)
  call "MT Generate Filter Coefficients.gvi"(pulse shaping filter="Root Raised Cos", pulse shaping samples per symbol=w10, modulation type="PSK") -> (pulse shaping filter coefficients=w12)
  call "1D Convolution (DBL).gvi"(x=w11, y=w12) -> (x * y=w13)
  call "Quick Scale 1D.gvi"(X=w13) -> (Y[i]=X[i]/Max|X|=w14)
  Real And Imaginary To Complex(x=w14, y=0) -> w15
  call "Insert Pilots.gvi"(signal input=w15) -> (output signal=w16)
  call "AddFrameHeader (complex).gvi"(array=w16) -> (output array=w17)
  Build Waveform Node(Y=w17, dt=w1) -> (output waveform=w18)
  $Baseband_Waveform <- w18
  $"upsampling factor L" <- w10
  w19 = cluster{"t0": timestamp, "dt": f64, "Y": c128[]} {all zero or empty}
  Property Node(instance in=w19, "dt"=w1, "Y"=w17) -> (instance out=w20)
  call "FFT Power Spectrum for 1 Chan (CDB)2.gvi"(time signal=w20, dB On (F)=TRUE) -> (power spectrum=w21)
  $"Baseband Power Spectrum" <- w21
  call "niUSRP Open Rx Session.gvi"(device names=$"device names") -> (error out=w22, session handle out=w23)
  call "niUSRP Configure Signal.gvi"(session handle=w23, IQ rate=$"IQ rate", carrier frequency=$"carrier frequency", gain=$"gain Rx", error in=w22, active antenna=$"active antenna Rx") -> (session handle out=w24, coerced carrier frequency=w25, error out=w26)
  Subtract(x=w25, y=20000) -> w27
  Property Node(instance in=w24, "LO Frequency"=w27) -> (instance out=w28)
  call "niUSRP Initiate.gvi"(session handle=w28, error in=w26) -> (session handle out=w29, error out=w30)
  call "niUSRP Fetch Rx Data (CDB).gvi"(session handle=w29, number of samples=1000000, error in=w30) -> (session handle out=w31, data=w32, error out=w33)
  call "niUSRP Close Session.gvi"(session handle=w31, error in=w33)
  call "niUSRP Open Tx Session.gvi"(device names=$"device names") -> (session handle out=w34, error out=w35)
  call "niUSRP Configure Signal.gvi"(session handle=w34, IQ rate=$"IQ rate", carrier frequency=$"carrier frequency", gain=$"gain Tx", error in=w35, active antenna=$"active antenna Tx") -> (session handle out=w36, error out=w37)
  while {
    call "niUSRP Write Tx Data (CDB).gvi"(session handle=w36, data=w17, error in=w37) -> (session handle out=w38, error out=w39)
    stop if $"stop Tx"
  }
  call "niUSRP Close Session.gvi"(session handle=w38, error in=w39)
  Multiply(3, w2) -> w40
  call "FrameSync.gvi"(Sampled Input=w32) -> (Aligned Samples=w41)
  call "Channel Estimator.gvi"(input signal=w41) -> (signal out=w42)
  Complex To Real Imaginary(x + iy=w42) -> (x=w43)
  call "MT Generate Filter Coefficients.gvi"(pulse shaping filter="Root Raised Cos", matched samples per symbol=w10, modulation type="PSK") -> (matched filter coefficients=w44)
  call "1D Convolution (DBL).gvi"(x=w43, y=w44) -> (x * y=w45)
  call "PulseAlign.gvi"(Input signal=w45, Receiver Sampling Factor=w10) -> (aligned output=w46)
  call "Decimate (single shot, CDB).gvi"(input array=w46, decimating factor=w10) -> (decimated array=w47)
  call "FrameSync.gvi"(Sampled Input=w47) -> (Aligned Samples=w48)
  Complex To Real Imaginary(x + iy=w48) -> (x=w49)
  Is Greater Than 0(x=w49) -> w50
  Boolean To Integer(Boolean=w50) -> (0, 1=w51)
  Array Subset(array=w51, index0=0, length0=w40) -> w52
  $"Output Bits" <- w52
  C Code Node("input"=w52, "size"=w40) -> ("bit_out"=w53)
  ~~~
  double bit_out;
  int value;
  for(unsigned int i = 0; i < size; i=i+3){
      value=input[i]+(input[i+1] << 1)+(input[i+2] << 2);
      switch(value){
          case(0):{
              bit_out = 0;
          }
          case(1):{
              bit_out = 0;
          }
          case(2):{
              bit_out = 0;
          }
          case(3):{
              bit_out = 1;
          }
          case(4):{
              bit_out = 0;
          }
          case(5):{
              bit_out = 1;
          }
          case(6):{
              bit_out = 1;
          }
          case(7):{
              bit_out = 1;
          }
      }
  }
  ~~~
  Waveform Array Subset(index=0, length=w2, waveform=w53)
  call "MT Calculate BER After Trigger (Fibonacci PN Sequence).gvi"(BER trigger threshold=0.4) -> (BER=w54, trigger found?=w55)
  $BER <- w54
  $"trigger found?" <- w55
