vi "FEC Decoder.gvi"   [LabVIEW Communications System Design Suite 2.0.1]
inputs:
  "data_in": i16[]
outputs:
  "output": i16[]
diagram:
  Array Size(array=$data_in) -> (size(s)=w1)
  Divide(x=w1, y=3) -> w2
  Math Node("data_in"=$data_in, "message_length"=w2) -> ("output"=w3)
  ~~~
  m1=data_in(1:message_length);
  m2=data_in((message_length+1):(2*message_length));
  m3=data_in(((2*message_length)+1):(3*message_length));
  out=zeros(1,message_length);
  out=int16(out);

  for i=1:message_length

      counter=0;
      if m1(1,i)==1
          counter=counter+1;
      end
      if m2(1,i)==1
          counter=counter+1;
      end
      if m3(1,i)==1
          counter=counter+1;
      end
      if counter>1
          out(1,i)=1;
      end
  end

  output=out;
  out=zeros(1,message_length);
  out=int16(out);
  ~~~
  $output <- w3
