vi "AddFrameHeader (complex).gvi"   [LabVIEW Communications System Design Suite 2.0.1]
inputs:
  "array": c128[]
outputs:
  "output array": c128[]
diagram:
  Build Array[ConcatenateInputs=True]([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], [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]) -> w1
  Insert Into Array(inArray=$array, index0=0, new=w1) -> w2
  $"output array" <- w2
  call "MT Generate Bits (Fibonacci, PN Order).gvi"(total bits=128, PN sequence order=9, seed in=-692092000) -> (output bit stream=w3)
  Real And Imaginary To Complex(x=w3, y=w3) -> w4
  Complex To Polar(r * e^(i*theta)=w4) -> (theta=w5)
  Polar To Complex(r=1, theta=w5)
