vi "AddFrameHeader.gvi"   [LabVIEW Communications System Design Suite 2.0.1]
inputs:
  "array": f64[]
outputs:
  "output array": f64[]
diagram:
  Build Array[ConcatenateInputs=True]([1, 1, 1, 1, 1, -1, -1, 1, 1, -1, 1, -1, 1], [1, 1, 1, 1, 1, -1, -1, 1, 1, -1, 1, -1, 1]) -> w1
  Insert Into Array(inArray=$array, index0=0, new=w1) -> w2
  $"output array" <- w2
