vi "Channel Estimator.gvi"   [LabVIEW Communications System Design Suite 2.0.1]
inputs:
  "input signal": c128[]
outputs:
  "signal out": c128[]
panel indicators:
  "output waveform (re)": waveform<f64>
  "output waveform (im)": waveform<f64>
  "output waveform (re)_est": waveform<f64>
  "output waveform (im)_est": waveform<f64>
uses:
  NI::Analysis::LinearAlgebra::Complex Conjugate Transpose Matrix.gvi
  NI::Analysis::LinearAlgebra::Complex A x B.gvi
  NI::Analysis::LinearAlgebra::Complex Inverse Matrix.gvi
diagram:
  Add(2500, 2500, 2500, 2500, 2500, 2500, 2500, 2500, 2500) -> w1
  Split 1D Array(array=$"input signal", index=w1) -> (first subarray=w2, second subarray=w3)
  Array Size(array=w2) -> (size(s)=w4)
  Reshape Array(inArray=w2, size=w4, size=1) -> w5
  Initialize Array(element=0.5+0.5i, size=2500) -> w6
  Initialize Array(element=0.5+0.5i, size=2500) -> w7
  Initialize Array(element=0.5+0.5i, size=2500) -> w8
  Initialize Array(element=0.5+0.5i, size=2500) -> w9
  Initialize Array(element=0.5+0.5i, size=2500) -> w10
  Initialize Array(element=0.5+0.5i, size=2500) -> w11
  Initialize Array(element=0.5+0.5i, size=2500) -> w12
  Initialize Array(element=0.5+0.5i, size=2500) -> w13
  Initialize Array(element=0.5+0.5i, size=2500) -> w14
  Interleave Array(w6, w7, w8, w9, w10, w11, w12, w13, w14) -> w15
  Array Size(array=w15) -> (size(s)=w16)
  Reshape Array(inArray=w15, size=w16, size=1) -> w17
  # X(H)
  call "Complex Conjugate Transpose Matrix.gvi"(matrix=w17) -> (matrix conjugate transpose=w18)
  # X(H)X
  call "Complex A x B.gvi"(matrix A=w18, matrix B=w17) -> (A x B=w19)
  call "Complex Inverse Matrix.gvi"(matrix=w19) -> (inverse matrix=w20)
  # (X(H)X)-1 X(H)
  # (X(H)X)-1
  call "Complex A x B.gvi"(matrix A=w20, matrix B=w18) -> (A x B=w21)
  # h^
  call "Complex A x B.gvi"(matrix A=w21, matrix B=w5) -> (A x B=w22)
  call "Complex Inverse Matrix.gvi"(matrix=w22) -> (inverse matrix=w23)
  Array Size(array=w3) -> (size(s)=w24)
  Reshape Array(inArray=w3, size=w24, size=1) -> w25
  call "Complex A x B.gvi"(matrix A=w25, matrix B=w23) -> (A x B=w26)
  Array Size(array=w26) -> (size(s)=w27)
  Multiply Array Elements(numeric array=w27) -> (product=w28)
  Reshape Array(inArray=w26, size=w28) -> w29
  $"signal out" <- w29
  Complex To Real Imaginary(x + iy=$"input signal") -> (x=w30, y=w31)
  Build Waveform Node(Y=w30) -> (output waveform=w32)
  $"output waveform (re)" <- w32
  Build Waveform Node(Y=w31) -> (output waveform=w33)
  $"output waveform (im)" <- w33
  Complex To Real Imaginary(x + iy=w29) -> (x=w34, y=w35)
  Build Waveform Node(Y=w34) -> (output waveform=w36)
  $"output waveform (re)_est" <- w36
  Build Waveform Node(Y=w35) -> (output waveform=w37)
  $"output waveform (im)_est" <- w37
